# Grasshopper definition Spin rotation.gh (Grasshopper 1.0.7)
# plug-ins: Bifocals

boundary = Slider(42, range=30..50)
center = Slider(4, range=0..10)
gap = Slider(16, range=5..20)
radius = Slider(5, range=0..10)
count = Slider(46, range=0..50)
expand = Slider(4, range=0..10)
gap_2 = GetNumber(gap, AtLeast=1, AtMost=1, Maximum=1.797693135e+308, Minimum=-1.797693135e+308)
count_2 = GetNumber(count, AtLeast=1, AtMost=1, Maximum=1.797693135e+308, Minimum=-1.797693135e+308)
expand_2 = GetNumber(expand, AtLeast=1, AtMost=1, Maximum=1.797693135e+308, Minimum=-1.797693135e+308)
center_2 = GetNumber(center, AtLeast=1, AtMost=1, Maximum=1.797693135e+308, Minimum=-1.797693135e+308)
boundary_2 = GetNumber(boundary, AtLeast=1, AtMost=1, Maximum=1.797693135e+308, Minimum=-1.797693135e+308)
radius_2 = GetNumber(radius, AtLeast=1, AtMost=1, Maximum=1.797693135e+308, Minimum=-1.797693135e+308)
negative = Negative(Value=boundary_2)
construct_domain = ConstructDomain(DomainStart=boundary_2, DomainEnd=negative)
circle = Circle(Plane=PlaneXY(0, 0, 0), Radius=gap_2)
decay = Slider(1.2, range=1..2)
divide_curve = DivideCurve(Curve=circle, Count=center_2, Kinks=False)  # -> Points, Tangents, Parameters
rectangle = Rectangle(Plane=PlaneXY(0, 0, 0), XSize=construct_domain, YSize=construct_domain, Radius=0)  # -> Rectangle, Length
spin_force = SpinForce(Plane=divide_curve.Points, Strength="0.3", Radius=expand_2, Decay=decay, Bounds=rectangle.Rectangle)
point_charge = PointCharge(Point=divide_curve.Points, Charge=Slider(0.4, range=0..1), Decay=Slider(1.5, range=0..10), Bounds=rectangle.Rectangle)
circle_2 = Circle(Plane=divide_curve.Points, Radius=radius_2)
merge_fields = MergeFields(Fields=[point_charge, spin_force])
divide_curve_2 = DivideCurve(Curve=circle_2, Count=count_2, Kinks=False)  # -> Points, Tangents, Parameters
boundary_surfaces = BoundarySurfaces(Edges=rectangle.Rectangle)
negative_2 = Negative(Value=Slider(1, range=0..1))
field_line = FieldLine(Field=merge_fields, Point=divide_curve_2.Points, Steps=1000, Accuracy=0.1, Method=3)
unit_z = UnitZ(Factor=negative_2)
extrude = Extrude(Base=boundary_surfaces, Direction=unit_z)
divide_curve_3 = DivideCurve(Curve=field_line, Count=10, Kinks=False)  # -> Points, Tangents, Parameters
nurbs_curve = NurbsCurve(Vertices=divide_curve_3.Points, Degree=3, Periodic=False)  # -> Curve, Length, Domain
mesh_brep = MeshBrep(
    Brep=extrude,
    Settings={GridMaxCount=0, GridMinCount=16, JaggedSeams=False, MaxEdgeLength=0, MinEdgeLength=0.0001, MinTolerance=0, Refine=True, RefineAngle=0, RelativeTolerance=0.65, SimplePlanes=True, Tolerance=0})
point_on_curve = PointOnCurve(nurbs_curve.Curve, parameter=0.507)

# ---- group: RH_OUT:mesh
mesh = Mesh(mesh_brep)

# ----
pull_point = PullPoint(Point=divide_curve_3.Points, Geometry=point_on_curve, ClosestOnly=True)  # -> ClosestPoint, Distance
graph_mapper = GraphMapper(
    pull_point.Distance,
    x0=0,
    x1=25,
    y0=0,
    y1=25,
    container_name="Bezier",
    cpx=[0, 0.2743379772, 0.4285906255, 1],
    cpy=[0.1078070998, 0.3133465052, 0, 0])
unit_z_2 = UnitZ(Factor=graph_mapper)
move = Move(Geometry=divide_curve_3.Points, Motion=unit_z_2)  # -> Geometry, Transform
nurbs_curve_2 = NurbsCurve(Vertices=move.Geometry, Degree=3, Periodic=False)  # -> Curve, Length, Domain
loft = Loft(
    Curves=[nurbs_curve.Curve, nurbs_curve_2.Curve],
    Options={Adjust=False, Closed=False, LoftEnds=0, LoftSimp=0, LoftType=0, Rebuild=10, Refit=0.01})
mesh_brep_2 = MeshBrep(
    Brep=loft,
    Settings={GridMaxCount=0, GridMinCount=16, JaggedSeams=False, MaxEdgeLength=0, MinEdgeLength=0.0001, MinTolerance=0, Refine=True, RefineAngle=0, RelativeTolerance=0.65, SimplePlanes=True, Tolerance=0})

# ---- group: RH_OUT:mesh
mesh_2 = Mesh(flatten(mesh_brep_2))
