# Grasshopper definition spin rotation.gh (Grasshopper 1.0.7)

get_number = GetNumber(Slider(200, range=0..1000), AtLeast=1, AtMost=1, Maximum=1.797693135e+308, Minimum=-1.797693135e+308)
get_number_2 = GetNumber(Slider(150, range=0..1000), AtLeast=1, AtMost=1, Maximum=1.797693135e+308, Minimum=-1.797693135e+308)
get_number_3 = GetNumber(Slider(1, range=0..10), AtLeast=1, AtMost=1, Maximum=1.797693135e+308, Minimum=-1.797693135e+308)
get_number_4 = GetNumber(Slider(2, range=0..10), AtLeast=1, AtMost=1, Maximum=1.797693135e+308, Minimum=-1.797693135e+308)
get_number_5 = GetNumber(Slider(220, range=0..1000), AtLeast=1, AtMost=1, Maximum=1.797693135e+308, Minimum=-1.797693135e+308)
get_number_6 = GetNumber(Slider(230, range=0..1000), AtLeast=1, AtMost=1, Maximum=1.797693135e+308, Minimum=-1.797693135e+308)
rectangle = Rectangle(Plane=PlaneXY(0, 0, 0), XSize=get_number_6, YSize=get_number_5, Radius=0)  # -> Rectangle, Length
unit_z = UnitZ(Factor=get_number)
extrude = Extrude(Base=rectangle.Rectangle, Direction=unit_z)
populate_3d = Populate3D(Region=extrude, Count=get_number_2, Seed=get_number_3)
octree = OcTree(Points=populate_3d, Square=Toggle(True), Group=get_number_4)  # -> Boxes, Points
box = Box(octree.Boxes)
deconstruct_brep = DeconstructBrep(Brep=box)  # -> Faces, Edges, Vertices
jitter = Jitter(List=box, Jitter=Slider(1, range=0..1), Seed=2)  # -> Values, Indices
split_list = SplitList(List=jitter.Values, Index=Slider(100, range=0..100))  # -> ListA, ListB
pipe = Pipe(Curve=deconstruct_brep.Edges, Radius=Slider(0.3, range=0..1), Caps=Slider(1, range=0..10))
box_2 = Box(split_list.ListB)
box_3 = Box(split_list.ListA)
merge = Merge(Data1=box_3, Data2=box_2)
mesh_brep = MeshBrep(
    Brep=merge,
    Settings={GridMaxCount=0, GridMinCount=16, JaggedSeams=False, MaxEdgeLength=0, MinEdgeLength=0.0001, MinTolerance=0, Refine=True, RefineAngle=0, RelativeTolerance=0.65, SimplePlanes=True, Tolerance=0})
mesh_colours = MeshColours(Mesh=mesh_brep, Colours=ColourSwatch(SwatchColor=RGB(255, 255, 255)))
c_script = CSharpScript(crv=deconstruct_brep.Edges, color=ColourSwatch(SwatchColor=RGB(5, 0, 0)))  # -> out, A; inputs crv: Curve, color: Color
# ---------- c_script: C# ----------
    var c = color.R + "," + color.G + "," + color.B;
    crv.SetUserString("color", c);
    A = crv;
# ---------- end c_script ----------

# ---- group: RH_OUT:mesh
mesh = Mesh(flatten(mesh_colours))

# ---- group: RH_OUT:edges
curve = Curve(flatten(c_script.A))
